# Grasshopper definition Recursive splitting.gh (Grasshopper 1.0.8)
# plug-ins: PTComponentLibrary

line = Line(Line((-347.2524447, 50.36641345, 0), (1271.628544, 67.75503845, 0)))
line_2 = Line(Line((887.3399309, 958.0526389, 0), (1043.837556, -241.7624867, 0)))
line_3 = Line(Line((-20.76847606, -32.71151667, 0), (29.42970216, 772.7410702, 0)))
line_4 = Line(Line((-76.67099271, 689.4577291, 0), (1191.973875, 722.542892, 0)))
merge = Merge(Data1=line_4, Data2=line)
merge_2 = Merge(Data1=line_3, Data2=line_2)
ptuvcrvs = IntersectCurves(CU=merge, CV=merge_2)
item = ListItem(List=ptuvcrvs, Index=0, Wrap=True)  # -> flatten(Item)
item_2 = ListItem(List=ptuvcrvs, Index="1", Wrap=True)  # -> flatten(Item)
rev = ReverseList(List=item_2)
merge_3 = Merge(Data1=item, Data2=rev)
pline = PolyLine(Vertices=merge_3, Closed=Toggle(True))
boundary = BoundarySurfaces(Edges=pline)
edges = BrepEdges(Brep=boundary)  # -> Naked, Interior, NonManifold
len = Length(Curve=edges.Naked)
sort = SortList(Keys=len, ValuesA=edges.Naked)  # -> Keys, reverse(ValuesA)
item_3 = ListItem(List=sort.ValuesA, Index=0, Wrap=True)
index = ItemIndex(List=edges.Naked, Item=item_3)
addition = Addition(A=index, B="2")
item_4 = ListItem(List=edges.Naked, Index=addition, Wrap=True)
midpt = CurveMiddle(Curve=item_3)
midpt_2 = CurveMiddle(Curve=item_4)
ln = Line(StartPoint=midpt, EndPoint=midpt_2)
srfsplit = SurfaceSplit(Surface=boundary, Curves=ln)
area = Area(Geometry=srfsplit)  # -> Area, Centroid
larger = LargerThan(FirstNumber=area.Area, SecondNumber="20000")  # -> LargerThan, OrEqualTo
dispatch = Dispatch(List=srfsplit, DispatchPattern=larger.LargerThan)  # -> ListA, ListB
srf = Surface(dispatch.ListA)
